# Grasshopper definition Pre-process.gh (Grasshopper 1.0.7)

# WINDOW AREA
panel = Panel("""4.941555,2.126707,2.126707,2.126707,2.126707,2.126707,2.126707
5.919127,1.511427,1.511427,1.511427
3.570964,1.953517,1.953517,1.953517
6.033181,1.282093,1.282093,1.282093
5.080287,1.772203,1.772203,1.772203
2.464541,3.649555,2.464541,2.464541
1.282093,6.033181,1.282093,1.282093
2.249941,8.556957,2.249941,2.249941
5.610588,1.737998,1.737998,1.737998,1.737998,1.737998,1.737998
1.756076,7.112795,1.756076,1.756076
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""")

# ----
# OPENING DIRECTION (CONTEXT SURFACE)
# Input
panel_2 = Panel("""north-east,south,south-east,east
south-east,east,south
east,north-east
south-east,east
north-west,west,south,south-east,east,north-east,north
south-east
west,south-east,east,north-east
south-east,north-west,west,south-west,south-west,south
south-east
north-east
south-east,north-east,west
south,south-east
south-west
north,north-west
north,west,south
east,north-east,south-east
north,north-west,south
west,east
east,north-east,north,north-west
south-east
north,north-west,west,south-east,east
south-east,north
south-west,south
south-east
south,south-east,east
south,south-east,east
north
east,north,south-west,south,south-east
north
east,north,north-west,west
north-east
south-west,south-west
north
west,south-west,south
west
south-west,south
north,west
south
south-east,south-west,south-west,south
east,north-east,south-east
south-east
north,north-east,south-east,south,south-west,west
north-west,north,north-east
north,north-west
south-east,north,south
south-west,south
north-east,west
north-east,north-west,south
north-east
south-east
east
north-west
east,north-east,north,north-west,west
south-east,north,north-west
north,west
north,north-west,west
south-east,east,north-east,north,south-west,south
south-east,east,north-west,west,south-west,south
south-east
north-east
south-east
south-east,east,north,west
south-east,east,south-west,south
south-east
north-west,west,south,south-east,east,north-east,north
south-east
north,west
north-east
south,south-east
south-west
south-west
west
north,north-west,south-west
east,north-west,west
north-east
south-east,south
east
south,south-east,east
south-east
north-east
south-west,south
south,south-east
east,west,north-west,north,north-east,east
west,east
north-west
north-west
south-east
west,north-east
north,north-west,west
north-west,west,south-west
north,south-west,south,south-east
north,north-west,west,south-west
north-west
north-west
south-west
north-west
east,north,west
north-east,west,south
north-west,south,east,north-east
north-east,south-west
north,west
north-west,west,south-west
west
east,south,south-east
south-west
south-west,south
south-east
south-west,south
south-east
north,west
north,west
north
west
south-east,east,north-east,north,north-west
north,north-west
south-east
north-west,west
north-east,north,north-west
north
east,north-east
east,south-west,south,south-east
south-east
south,east
south-east
south,south-east,east
south-west
south-east
north-east
north-east
north-east
east,west
south,south-east,east
south-east,west
east,south-west
south-east,east,north-east,south
north-west
south,south-east
west,south,south-east,east
east
north,north-west,south-west,south
south-west
north-west,east
north-west,east
south-west
north,north-west
north-east,north
north-east
east
south
south-east
north
north-east,north,north-west,west,south-east,east
north-east
north-east,south,south-east,east
south-east
south-east,east,north-east,north,north-west,south
south
south-east,south,south-west,north-west,north,north-east,east
east
south-east,east
north-east,south-west,south,south-east
north,north-west
south
south-east
north-east,north,north-west,south
south-east,north,west,south-west,south
east,south
north-east,north-west
west,north-east
north-east
south,south-east
north,north-west
south-east
north-west,west
south-east,east,north-east,north,west,south-west,south
east,north-west
south-west,south
north
east,north-west,west
south-east,east,north-east,north,south-west,south
south-east,west
north-east
north-east,north-west
east
north,north-west,west
east
north,north-west
north-east
south-west,south
south-west,north-east
east,north-east,south-east
west
north-west,north,north-east
south-east,north-east,north,north-west,west
west
south-east
north-west,west
west
east,north
south-east
south-east
north,north-west,west
north-east
south-west,south,east,north-east
south-east,east
south
south-east,north,west,south-west
north,north-west
south-east,north-east,north,west,south
north,north-west,west
west,south,south-east,east,north-east,north,north-west
south-east
south-east,east
north-west
south-east,north-west,west
north-east,north,north-west,west,south-west
north-west
east
east,north-east,north,north-west,west
east,north-east,north,north-west,west
east,north-east,north,north-west,west
north,west
west,south-west,south
south-east
east,north-east,north,north-west
north
north,north-west,west
west
east,north-east,south-east
east,north-east,south,south-east
south-east,west,south-west
south-east,south-west,south-west,south
east,north-east,north,north-west
south-west,south,south-east
south
south-west
south-east,south-west,south-west
south,south-east,east
south-east,west
north-west,south,east,north-east,north
south,east,north-east,north
north-east
south,south-east
east,north-east,north-west,south-west
north,north-west,west
north
south-east
south-east,east,south
south-east,east,north-east,north,north-west
east,north
north,north-west
east,north,west,south-west,south,south-east
east,north,south-west,south,south-east
east,south-west,south,south-east
north-east,south-west
north-west,west,south,south-east,east,north-east,north
south-east,north-west,west
north-east
east,north,north-west,south-west,south,south-east
east,west
south-west
south,south-east,east,north-west
north-west,south-east,north
east
east,north-east
north-east,north,west,south-west,south,east
south,south-east
north-east,south-west,south
south-east
south-east
north-east,north,north-west,west
west
south-east,north-east,south-west
north-east
north,north-west,west
south,south-east
south-west
north-west
south-east,east,south-west,south-west,south
south-east,east
east,north-east,south-west,south,south-east
north
north,north-west,west
west,north-west,north
south-east,north,north-west,west
east
south-east,west
west,north-west
south
west,south-west,south,south-east
north-west
north,north-west
south-east
north-east,west,south-east
east,north-east,north-west,west
east,south-west,south
east,north,south
north-east
south-east,south-west,south-west,south
north-east,east
north-west
north,west,south-west
north,north-west
south-east,north-east,north,west,south
north-east,north
south-east
east
north
north
south,south-east
south-east,east
south,east
south-east,east,north-east,south
north
north-west
south,south-east
south-west,south,north-east,north,west
north-east,north,west,south-west,south
north-west
south,south-east,north
south-east,east,north-east,north,south
north-west,north-east
north-east
west
south,south-east,east
south,south-east,east,north
east,south,south-east
south-east,south-west,south
north-east
south-east,north-east,north-west,west,south-west,south-west,south
east,north-west,south,south-east
north,south
north-east,north,north-west,south-west
south-west,south,south-east
north-east
south-east,north-west,west,south-west,south-west,south
north-east,south-west
south-east,west,south-west,south
east,north-east,north-west
east,south-west,south,south-east
south-west
south
north-west
west
north-west,west
south-west,south,south-east
north
south-west,south
north-west
east,north-east
north,north-west
north,north-west,west
north,north-west,west,south-west
north,south
south,south-east
north-west,west,south-west,south,south-east
east,south
east,north-east
east,west,south-east
north,south-east
south
north-west,south
south,south-east,east
north
west
south-east
south-east,west
south-east,west
north-west,south,east,north-east
north-east
north,north-west,west,south-west
north-east,north,north-west,west,south-west
south-east,east
north-east,north-west,west
south-west
south-east,south-west
south-east,south-west,south
north,north-west,west,east
south-west
south-west
north-east,north
north,north-west,west
south-west,south,north-east,north,west
north,north-east,east,south
east
north-east,north
west,north-west,north
west,south,south-east
north
east,south-west,south,south-east
north-east
west
north-east
north-west
north-west,south,south-east
south-east,east,north-west,west,south-west,south
west,south
north-east,north,north-west,west
south-west
north-east,south-west,west,north-west,north
north-east
east,west,south-east
south
north-east,west,south-east
north,south-east
south,east
east,north-east,north-west,west
east,north-west,west
north-west
south-east,east,north-east,west
south-east,east,north-east""")

# ----
# WINDOW DIRECTION
# Input
panel_3 = Panel("""west,south-west,south
non
north-east
non
south-east
non
non
north,north-west,west
non
south-west,east
south,south-east
north-east
south-west
north-east
south-east,east,north-east
north-east
non
south,south-east
non
north-east,south
south-east,west,south-west
north-east,north,south-west,east
non
north-west
non
non
south
north-east,north,north-west,south-west,south
non
south-west,south,south-east,east
south-east,east,north-east,north,north-west,west,south-west,south
south-west,south,south-east,east,north-east,north-west
north
north
north,west,south-west,south,south-east
south,south-east,east,north-east
non
west,south,south-east,east,north-east
south,south-east
north,south,south-east,east
west
south,south-west
south-east
north-west
south-east,east,north-east
south-east,north-east
non
non
north,north-west,south
south,south-east,east
non
north-east,south
north,south-west,south
non
north,north-west,west
north-east,north,west
non
south,south-east,east,north-east
south-west
north,south-west,south
north-west,south-east,east,north-east
north,south-east,east
north-east,north-west
south,north
south-east,north-east,north,north-west,west
north-east
south
north
north-east
non
non
south,south-east
south-east
non
non
non
north-east,north,north-west,west
north-west,west
north-west,west
non
north-east,north,north-west,west
south-east,south
non
non
non
south,south-east,north-east
non
north-east,north,east
non
west,north-west,north
non
non
south,west,north-west,north-east
east
south
north-east
south,south-east
north,north-west,west
south
non
non
non
north-east,north
north
north,north-west,west,south-west
non
non
non
north-east,north,north-west,west
non
north-west,west
south-west,south
north
south-east
east
north-east,east
non
non
south-east,north-east
non
north,north-west,west
north-east
west,south-west
south-east,east
north,north-west
west
north,south-west,south,south-east,north-east
north,north-west
north,west
non
non
north-west,north,north-east
non
non
north-east
north,north-west,west,south-west,south,south-east
non
south-east
west,south-west,south
south,south-east
south-east,east,north-east,north,north-west,west
non
north-west
north,north-west,south
south-west,south
south-west
south,south-east,north
north-east,south
non
south-west,south
north
south-east,east
south-west,south
north,north-west,west,south-west,south,south-east,east,north-east
south,south-east
south,south-east
north-east
non
south
non
west,south-west,south
south-east
west,south-west,south
non
non
north-east,south,south-east,east
north,south-west
non
non
south
non
north,north-west,south-west,south,south-east
non
south-east
non
west
non
north-east,east,south
east,east,north-east,north
north-west
north,north-west,west
non
north,north-west,west
north-east,north,north-west,south,south-east,east
north-east,west
non
south
north,north-west
north-east,west,south,south
non
non
non
south,south-east
south,south-east,east
north-west,west,south-west
east,north-east
north-west,south-west
south-west,east,west
north,west
north-east,east
east,north-east,north,west,south-west,south
north,north-west,south,north-east
north
south
north-east
south-west,west,north-west,north
non
north-east,south-east,east
north-west,north
north
south-west,north-east,north,north-west
south,south-west,north,south-east
north-west
north-west
north-west
north-east,north,north-west,west,east
south-east,east,south-west
north-east,north
non
north-east,south-west,south,south-east
north,north-west,south-west,south,south-east
north,north-west
north-east,north,west,south-west,south
non
north,north-west,west,south-west,south
north-east,north,north-west,south,south-east,east
north-west,west,south-west,south,south-east,east
non
north,north-west,west,south-west
non
north-west,west
south-west,north-west,west
north,north-west,west
non
non
north,north-west
south-east,south
non
non
north
north-east
east
non
non
south
east,south-east
west,south-east
north-west,west
non
non
south-west,south,south-east,east
north-east
north-east
non
south-east,east,north-east,north,north-west,west
north-west
north-west,north-east,north
south,south-east,east,west
non
north-west,east
non
south,south-east,east,north-east,north,north-west,west
north
south-east,north-east
non
non
east,south-east,south,south-west
non
north-west
south-west
south-east,north-east
south-east,east
non
non
east,north-west
south-west,south
south-east,north-east
south-east,east,north-east
non
south-west,west,north-west,north,south-east
north-east,north,north-west,south,east
non
non
non
north,west
north-east
north,north-west,south-west
north,north-west
south-west,north
non
north-west,west
north-west,west,south-west,south,south-east
north,north-west,west
non
north-east,north,south,south-east,south-east,east
north,north-west,east
non
west,north-west,north,north-east,east,south-west
west,south,south-east,east,north-east
non
north,north-west
north-west,north,north-east,east
north,south-west
north-west,north-east,north
south-west
non
non
west,north-west,north
south-east,east,south
non
north-east
non
non
west,south-west,south,south-east,east
non
south-west
non
non
north-east,south,south-east,east
north-east
south-west
north,north-west
non
non
non
west,south
west,north-east
north,north-west
north,north-west,south-west,east
south,south-east
non
south-east
west,north-west,north
north-west
non
south
north-east,north,south-east,south-east,east
south,south-east,east
south
non
non
non
non
north,north-west,west
north-west,west
south-west
non
south-west
south-east,east
north-west
south-east,west
non
north
non
north-east
north-east,north,north-west,west,south-west
non
non
non
south,south-east,north-west
west,south,south,south-east,east
north
south,north-east
north-west
north-east,north-west
north-east,north,south,south-east,east
north,north-west,west
north-east
south-east,north-east,north,north-west,west
south
non
west,north-west
non
non
south,south-east,east
west,south,south-east,east
north,north-west
north-west
south-west,south
south-west,north-west
north
north-east,north,north-west,west
non
west,south,south-east,east
north,north-west,west
non
north,north-west,west
non
south-west,south,west
north,north-west
non
north-west,south-west,east
north,north-west,south-west,south
east
non
west,south-east
west,south,east,north-east,north,north-west
south-west,south,south-east,east
non
north-east
non
north-west
east
west,south,south
north,west
non
north,north-west,south,north-east
non
north,east
north-east,south-west
south-east,east,north-east
south,south-east
north-west,south-west,south
north,north-west
north-east,south
south
north-west,north
west,south-east,east,north-east,north,north-west
north,north-west,south-west,south
north
north-east,north,north-west,west,south-east,east
non
south,south-east
non
north
non
south-east
south,south-east,east
south-east,east,south
north,south,south-east
north-east,north-west,west,south-west,south,south-east,east
south-west
north-east
non
south-east,north-east,north,north-west,west
non
north,north-west,south
north-east
non
non
south,south-east
non
south-west,south
west,north-west,north,north-east,east,south-west
non
non
east,south-east
non
south-east,east,north-east,north,north-west,west
south-east
non
west,south-west,north-east,north
non
north,north-west,west
north-west,south-east,east,east
south,east
south-west,south-east,east
south-east,north,south-west,south
north
south-east,south,north-west,north,north-east,east
non
north-west,west,south-west,south,south-east,east
south-east,east,south
south,south-east,east,north-west,south-west
non
north,north-west,west
west,south-west,south-east
non
north,north-west
north-west,west
south
north-east,south,south-east,east
south-east,east,south
south-west,west,north-west
south-east,east,north-east,north,north-west,west
non
north,north-west
west,north-west
south-west,west,north-west,north
north-east,north,north-west,west
non
south-east
non
south,east
south
east,north-east
south-east
non
south,south-east
north-east,north,north-west,south-west,south-east
non
north,north-west,west,south
non
east,south,north
south,south-east
non
east
south-east,east,north-east,north,north-west,west
non""")

# ----
# Schedule
panel_4 = Panel("""occ05_mix
occ02_mix
occ01_mix
occ02_mix
occ05_mix
occ01_mix
occ02_mix
occ01_mix
occ02_mix
occ02_mix
occ05_mix
occ05_mix
occ01_mix
occ05_mix
occ01_mix
occ01_mix
occ01_mix
occ05_mix
occ05_mix
occ01_mix
occ02_mix
occ05_mix
occ01_mix
occ05_mix
occ01_mix
occ01_mix
occ02_mix
occ01_mix
occ01_mix
occ01_mix
occ05_mix
occ01_mix
occ05_mix
occ01_mix
occ02_mix
occ02_mix
occ01_mix
occ05_mix
occ02_mix
occ01_mix
occ05_mix
occ02_mix
occ05_mix
occ05_mix
occ01_mix
occ01_mix
occ05_mix
occ05_mix
occ01_mix
occ01_mix
occ01_mix
occ05_mix
occ01_mix
occ01_mix
occ05_mix
occ01_mix
occ02_mix
occ01_mix
occ01_mix
occ01_mix
occ05_mix
occ01_mix
occ01_mix
occ05_mix
occ01_mix
occ01_mix
occ01_mix
occ05_mix
occ01_mix
occ01_mix
occ01_mix
occ05_mix
occ01_mix
occ02_mix
occ02_mix
occ05_mix
occ02_mix
occ02_mix
occ01_mix
occ02_mix
occ01_mix
occ05_mix
occ01_mix
occ01_mix
occ01_mix
occ02_mix
occ02_mix
occ02_mix
occ01_mix
occ01_mix
occ01_mix
occ01_mix
occ02_mix
occ05_mix
occ05_mix
occ01_mix
occ02_mix
occ01_mix
occ01_mix
occ02_mix
occ02_mix
occ02_mix
occ02_mix
occ05_mix
occ01_mix
occ02_mix
occ01_mix
occ05_mix
occ01_mix
occ01_mix
occ05_mix
occ02_mix
occ01_mix
occ01_mix
occ05_mix
occ01_mix
occ01_mix
occ01_mix
occ01_mix
occ05_mix
occ01_mix
occ02_mix
occ02_mix
occ01_mix
occ05_mix
occ01_mix
occ05_mix
occ02_mix
occ01_mix
occ05_mix
occ02_mix
occ01_mix
occ01_mix
occ02_mix
occ01_mix
occ01_mix
occ02_mix
occ01_mix
occ01_mix
occ05_mix
occ01_mix
occ01_mix
occ01_mix
occ01_mix
occ01_mix
occ01_mix
occ02_mix
occ01_mix
occ02_mix
occ01_mix
occ01_mix
occ01_mix
occ01_mix
occ01_mix
occ01_mix
occ05_mix
occ05_mix
occ01_mix
occ05_mix
occ01_mix
occ01_mix
occ01_mix
occ01_mix
occ01_mix
occ01_mix
occ01_mix
occ01_mix
occ01_mix
occ01_mix
occ01_mix
occ01_mix
occ05_mix
occ01_mix
occ02_mix
occ02_mix
occ01_mix
occ01_mix
occ05_mix
occ01_mix
occ01_mix
occ01_mix
occ01_mix
occ02_mix
occ02_mix
occ01_mix
occ01_mix
occ01_mix
occ05_mix
occ01_mix
occ01_mix
occ01_mix
occ01_mix
occ01_mix
occ01_mix
occ01_mix
occ01_mix
occ05_mix
occ01_mix
occ02_mix
occ01_mix
occ05_mix
occ01_mix
occ01_mix
occ01_mix
occ02_mix
occ05_mix
occ05_mix
occ05_mix
occ01_mix
occ05_mix
occ05_mix
occ01_mix
occ01_mix
occ01_mix
occ02_mix
occ01_mix
occ01_mix
occ01_mix
occ05_mix
occ01_mix
occ02_mix
occ01_mix
occ02_mix
occ02_mix
occ01_mix
occ01_mix
occ02_mix
occ01_mix
occ01_mix
occ01_mix
occ01_mix
occ01_mix
occ01_mix
occ01_mix
occ01_mix
occ01_mix
occ01_mix
occ01_mix
occ02_mix
occ02_mix
occ01_mix
occ01_mix
occ05_mix
occ01_mix
occ01_mix
occ01_mix
occ01_mix
occ01_mix
occ01_mix
occ01_mix
occ01_mix
occ05_mix
occ01_mix
occ05_mix
occ01_mix
occ01_mix
occ01_mix
occ01_mix
occ05_mix
occ05_mix
occ02_mix
occ05_mix
occ02_mix
occ05_mix
occ05_mix
occ01_mix
occ01_mix
occ02_mix
occ01_mix
occ01_mix
occ01_mix
occ01_mix
occ01_mix
occ01_mix
occ01_mix
occ01_mix
occ01_mix
occ01_mix
occ01_mix
occ01_mix
occ01_mix
occ01_mix
occ02_mix
occ01_mix
occ01_mix
occ01_mix
occ05_mix
occ01_mix
occ02_mix
occ01_mix
occ01_mix
occ01_mix
occ01_mix
occ01_mix
occ02_mix
occ05_mix
occ05_mix
occ05_mix
occ05_mix
occ02_mix
occ02_mix
occ02_mix
occ01_mix
occ05_mix
occ01_mix
occ01_mix
occ01_mix
occ01_mix
occ01_mix
occ01_mix
occ01_mix
occ01_mix
occ02_mix
occ01_mix
occ01_mix
occ01_mix
occ01_mix
occ01_mix
occ01_mix
occ01_mix
occ01_mix
occ01_mix
occ02_mix
occ01_mix
occ01_mix
occ05_mix
occ01_mix
occ01_mix
occ01_mix
occ05_mix
occ01_mix
occ01_mix
occ05_mix
occ01_mix
occ01_mix
occ01_mix
occ01_mix
occ01_mix
occ01_mix
occ01_mix
occ01_mix
occ02_mix
occ05_mix
occ01_mix
occ01_mix
occ01_mix
occ01_mix
occ01_mix
occ05_mix
occ01_mix
occ02_mix
occ05_mix
occ05_mix
occ01_mix
occ05_mix
occ01_mix
occ02_mix
occ01_mix
occ01_mix
occ01_mix
occ05_mix
occ01_mix
occ02_mix
occ02_mix
occ01_mix
occ02_mix
occ02_mix
occ01_mix
occ02_mix
occ02_mix
occ02_mix
occ01_mix
occ01_mix
occ01_mix
occ05_mix
occ02_mix
occ01_mix
occ01_mix
occ02_mix
occ02_mix
occ01_mix
occ02_mix
occ01_mix
occ01_mix
occ01_mix
occ01_mix
occ05_mix
occ01_mix
occ01_mix
occ01_mix
occ01_mix
occ01_mix
occ01_mix
occ05_mix
occ02_mix
occ05_mix
occ02_mix
occ02_mix
occ01_mix
occ01_mix
occ01_mix
occ01_mix
occ01_mix
occ01_mix
occ01_mix
occ01_mix
occ01_mix
occ01_mix
occ01_mix
occ01_mix
occ05_mix
occ01_mix
occ01_mix
occ01_mix
occ01_mix
occ02_mix
occ01_mix
occ01_mix
occ01_mix
occ01_mix
occ01_mix
occ05_mix
occ05_mix
occ01_mix
occ01_mix
occ05_mix
occ01_mix
occ01_mix
occ05_mix
occ05_mix
occ02_mix
occ01_mix
occ01_mix
occ01_mix
occ01_mix
occ01_mix
occ05_mix
occ05_mix
occ01_mix
occ01_mix
occ05_mix
occ02_mix
occ01_mix
occ01_mix
occ01_mix
occ02_mix
occ01_mix
occ01_mix
occ02_mix
occ02_mix
occ01_mix
occ01_mix
occ01_mix
occ01_mix
occ05_mix
occ02_mix
occ01_mix
occ01_mix
occ02_mix
occ05_mix
occ01_mix
occ01_mix
occ01_mix
occ01_mix
occ01_mix
occ01_mix
occ02_mix
occ01_mix
occ02_mix
occ01_mix
occ01_mix
occ01_mix
occ01_mix
occ01_mix
occ01_mix
occ01_mix
occ02_mix
occ01_mix
occ01_mix
occ05_mix
occ02_mix
occ01_mix
occ01_mix
occ05_mix
occ01_mix
occ01_mix
occ02_mix
occ01_mix
occ01_mix
occ01_mix
occ01_mix
occ01_mix
occ05_mix
occ01_mix
occ01_mix
occ01_mix
occ01_mix
occ01_mix
occ02_mix
occ01_mix
occ02_mix
occ01_mix
occ01_mix
occ01_mix
occ01_mix
occ02_mix
occ01_mix
occ01_mix
occ01_mix
occ02_mix
occ02_mix
occ05_mix
occ01_mix
occ01_mix
occ01_mix
occ01_mix
occ05_mix
occ01_mix
occ02_mix
occ05_mix
occ01_mix
occ05_mix
occ02_mix
occ01_mix""")
# Construction
panel_5 = Panel("""Wall_BEF
Wall_BEF
Wall_BEF
Wall_BEF
WALL_AFT
Wall_BEF
Wall_BEF
Wall_BEF
Wall_BEF
Wall_BEF
Wall_BEF
Wall_BEF
Wall_BEF
Wall_BEF
Wall_BEF
Wall_BEF
Wall_BEF
Wall_BEF
WALL_AFT
Wall_BEF
Wall_BEF
Wall_BEF
Wall_BEF
Wall_BEF
Wall_BEF
Wall_BEF
Wall_BEF
Wall_BEF
Wall_BEF
Wall_BEF
WALL_AFT
Wall_BEF
WALL_AFT
Wall_BEF
Wall_BEF
Wall_BEF
Wall_BEF
WALL_AFT
Wall_BEF
Wall_BEF
Wall_BEF
Wall_BEF
WALL_AFT
Wall_BEF
Wall_BEF
Wall_BEF
Wall_BEF
Wall_BEF
Wall_BEF
Wall_BEF
Wall_BEF
Wall_BEF
Wall_BEF
Wall_BEF
WALL_AFT
Wall_BEF
Wall_BEF
Wall_BEF
Wall_BEF
Wall_BEF
Wall_BEF
Wall_BEF
Wall_BEF
Wall_BEF
Wall_BEF
Wall_BEF
Wall_BEF
Wall_BEF
Wall_BEF
Wall_BEF
Wall_BEF
Wall_BEF
Wall_BEF
Wall_BEF
Wall_BEF
Wall_BEF
Wall_BEF
Wall_BEF
Wall_BEF
Wall_BEF
Wall_BEF
Wall_BEF
Wall_BEF
Wall_BEF
Wall_BEF
Wall_BEF
Wall_BEF
Wall_BEF
Wall_BEF
Wall_BEF
Wall_BEF
Wall_BEF
Wall_BEF
WALL_AFT
Wall_BEF
Wall_BEF
Wall_BEF
Wall_BEF
Wall_BEF
Wall_BEF
Wall_BEF
Wall_BEF
Wall_BEF
Wall_BEF
Wall_BEF
Wall_BEF
Wall_BEF
Wall_BEF
Wall_BEF
Wall_BEF
WALL_AFT
Wall_BEF
Wall_BEF
Wall_BEF
WALL_AFT
Wall_BEF
Wall_BEF
Wall_BEF
Wall_BEF
Wall_BEF
Wall_BEF
Wall_BEF
Wall_BEF
Wall_BEF
WALL_AFT
Wall_BEF
Wall_BEF
Wall_BEF
Wall_BEF
WALL_AFT
Wall_BEF
Wall_BEF
Wall_BEF
Wall_BEF
Wall_BEF
Wall_BEF
Wall_BEF
Wall_BEF
Wall_BEF
Wall_BEF
Wall_BEF
Wall_BEF
Wall_BEF
Wall_BEF
Wall_BEF
Wall_BEF
Wall_BEF
Wall_BEF
Wall_BEF
Wall_BEF
Wall_BEF
Wall_BEF
Wall_BEF
Wall_BEF
Wall_BEF
WALL_AFT
WALL_AFT
Wall_BEF
Wall_BEF
Wall_BEF
Wall_BEF
Wall_BEF
Wall_BEF
Wall_BEF
Wall_BEF
Wall_BEF
Wall_BEF
Wall_BEF
Wall_BEF
Wall_BEF
Wall_BEF
Wall_BEF
Wall_BEF
Wall_BEF
Wall_BEF
Wall_BEF
Wall_BEF
Wall_BEF
Wall_BEF
Wall_BEF
Wall_BEF
Wall_BEF
Wall_BEF
Wall_BEF
Wall_BEF
Wall_BEF
Wall_BEF
WALL_AFT
Wall_BEF
Wall_BEF
Wall_BEF
Wall_BEF
Wall_BEF
Wall_BEF
Wall_BEF
Wall_BEF
WALL_AFT
Wall_BEF
Wall_BEF
Wall_BEF
WALL_AFT
Wall_BEF
Wall_BEF
Wall_BEF
Wall_BEF
Wall_BEF
WALL_AFT
Wall_BEF
Wall_BEF
WALL_AFT
Wall_BEF
Wall_BEF
Wall_BEF
Wall_BEF
Wall_BEF
Wall_BEF
Wall_BEF
Wall_BEF
Wall_BEF
Wall_BEF
Wall_BEF
Wall_BEF
Wall_BEF
Wall_BEF
Wall_BEF
Wall_BEF
Wall_BEF
Wall_BEF
Wall_BEF
Wall_BEF
Wall_BEF
Wall_BEF
Wall_BEF
Wall_BEF
Wall_BEF
Wall_BEF
Wall_BEF
Wall_BEF
Wall_BEF
Wall_BEF
Wall_BEF
Wall_BEF
Wall_BEF
Wall_BEF
Wall_BEF
Wall_BEF
Wall_BEF
Wall_BEF
Wall_BEF
Wall_BEF
Wall_BEF
Wall_BEF
Wall_BEF
WALL_AFT
Wall_BEF
Wall_BEF
Wall_BEF
Wall_BEF
Wall_BEF
Wall_BEF
Wall_BEF
Wall_BEF
Wall_BEF
Wall_BEF
Wall_BEF
Wall_BEF
Wall_BEF
Wall_BEF
Wall_BEF
Wall_BEF
Wall_BEF
Wall_BEF
Wall_BEF
Wall_BEF
Wall_BEF
Wall_BEF
Wall_BEF
Wall_BEF
Wall_BEF
Wall_BEF
Wall_BEF
Wall_BEF
Wall_BEF
Wall_BEF
Wall_BEF
Wall_BEF
Wall_BEF
Wall_BEF
Wall_BEF
Wall_BEF
Wall_BEF
Wall_BEF
Wall_BEF
Wall_BEF
Wall_BEF
Wall_BEF
Wall_BEF
WALL_AFT
Wall_BEF
Wall_BEF
Wall_BEF
Wall_BEF
Wall_BEF
Wall_BEF
Wall_BEF
Wall_BEF
Wall_BEF
Wall_BEF
Wall_BEF
Wall_BEF
Wall_BEF
Wall_BEF
Wall_BEF
Wall_BEF
Wall_BEF
Wall_BEF
Wall_BEF
Wall_BEF
Wall_BEF
Wall_BEF
Wall_BEF
Wall_BEF
Wall_BEF
Wall_BEF
Wall_BEF
WALL_AFT
Wall_BEF
Wall_BEF
Wall_BEF
Wall_BEF
Wall_BEF
Wall_BEF
Wall_BEF
Wall_BEF
Wall_BEF
Wall_BEF
Wall_BEF
Wall_BEF
Wall_BEF
Wall_BEF
Wall_BEF
Wall_BEF
WALL_AFT
Wall_BEF
Wall_BEF
Wall_BEF
Wall_BEF
Wall_BEF
Wall_BEF
Wall_BEF
Wall_BEF
WALL_AFT
Wall_BEF
Wall_BEF
WALL_AFT
Wall_BEF
Wall_BEF
Wall_BEF
Wall_BEF
Wall_BEF
WALL_AFT
Wall_BEF
Wall_BEF
Wall_BEF
Wall_BEF
Wall_BEF
Wall_BEF
Wall_BEF
Wall_BEF
Wall_BEF
Wall_BEF
Wall_BEF
Wall_BEF
Wall_BEF
WALL_AFT
Wall_BEF
Wall_BEF
Wall_BEF
Wall_BEF
Wall_BEF
Wall_BEF
Wall_BEF
Wall_BEF
Wall_BEF
Wall_BEF
Wall_BEF
Wall_BEF
Wall_BEF
Wall_BEF
Wall_BEF
Wall_BEF
Wall_BEF
Wall_BEF
WALL_AFT
Wall_BEF
WALL_AFT
Wall_BEF
Wall_BEF
Wall_BEF
Wall_BEF
Wall_BEF
Wall_BEF
Wall_BEF
Wall_BEF
Wall_BEF
Wall_BEF
Wall_BEF
Wall_BEF
Wall_BEF
Wall_BEF
Wall_BEF
Wall_BEF
Wall_BEF
Wall_BEF
Wall_BEF
Wall_BEF
Wall_BEF
Wall_BEF
Wall_BEF
Wall_BEF
Wall_BEF
Wall_BEF
Wall_BEF
Wall_BEF
Wall_BEF
Wall_BEF
Wall_BEF
Wall_BEF
WALL_AFT
WALL_AFT
Wall_BEF
Wall_BEF
Wall_BEF
Wall_BEF
Wall_BEF
Wall_BEF
Wall_BEF
WALL_AFT
Wall_BEF
Wall_BEF
WALL_AFT
Wall_BEF
Wall_BEF
Wall_BEF
Wall_BEF
Wall_BEF
Wall_BEF
Wall_BEF
Wall_BEF
Wall_BEF
Wall_BEF
Wall_BEF
Wall_BEF
Wall_BEF
WALL_AFT
Wall_BEF
Wall_BEF
Wall_BEF
Wall_BEF
Wall_BEF
Wall_BEF
Wall_BEF
Wall_BEF
Wall_BEF
Wall_BEF
Wall_BEF
Wall_BEF
Wall_BEF
Wall_BEF
Wall_BEF
Wall_BEF
Wall_BEF
Wall_BEF
Wall_BEF
Wall_BEF
Wall_BEF
Wall_BEF
Wall_BEF
Wall_BEF
Wall_BEF
Wall_BEF
Wall_BEF
Wall_BEF
WALL_AFT
Wall_BEF
Wall_BEF
Wall_BEF
Wall_BEF
Wall_BEF
Wall_BEF
Wall_BEF
Wall_BEF
WALL_AFT
Wall_BEF
Wall_BEF
Wall_BEF
Wall_BEF
Wall_BEF
Wall_BEF
Wall_BEF
Wall_BEF
Wall_BEF
Wall_BEF
Wall_BEF
Wall_BEF
Wall_BEF
Wall_BEF
Wall_BEF
Wall_BEF
Wall_BEF
Wall_BEF
Wall_BEF
Wall_BEF
Wall_BEF
Wall_BEF
Wall_BEF
WALL_AFT
Wall_BEF
Wall_BEF
Wall_BEF
Wall_BEF
Wall_BEF
Wall_BEF
Wall_BEF""")
python = GhPythonScript(x=panel_4)  # -> out, a
# ---------- python: Python ----------
__author__ = "orcun"
__version__ = "2020.02.25"

import rhinoscriptsyntax as rs
if x == 'occ01_mix':
    a = 0
elif x == 'occ02_mix':
    a = 1
elif x == 'occ05_mix':
    a = 2
# ---------- end python ----------
python_2 = GhPythonScript(x=panel_5)  # -> out, a
# ---------- python_2: Python ----------
__author__ = "orcun"
__version__ = "2020.02.25"

import rhinoscriptsyntax as rs
if x == 'Wall_BEF':
    a = 0
else:
    a = 1
# ---------- end python_2 ----------
panel_6 = Panel(python.a)
panel_7 = Panel(python_2.a)
split = TextSplit(Text=panel, Separators=",")
split_2 = TextSplit(Text=panel_2, Separators=",")
split_3 = TextSplit(Text=panel_3, Separators=",")
panel_8 = Panel(split)
panel_9 = Panel(split_2)
panel_10 = Panel(split_3)
ma = MassAddition(Input=panel_8)  # -> flatten(Result), PartialResults
python_3 = GhPythonScript(x=panel_9)  # -> out, a; inputs x: list
# ---------- python_3: Python ----------
__author__ = "orcun"
__version__ = "2020.02.21"

import rhinoscriptsyntax as rs

a = list(filter(None,x))
# ---------- end python_3 ----------
python_4 = GhPythonScript(x=panel_10)  # -> out, a; inputs x: list; same code as python_3
panel_11 = Panel(python_3.a)
panel_12 = Panel(ma.Result)
panel_13 = Panel(python_4.a)
python_5 = GhPythonScript(x=panel_11)  # -> out, a; inputs x: list
# ---------- python_5: Python ----------
__author__ = "orcun"
__version__ = "2020.02.21"

import rhinoscriptsyntax as rs

a = list(set(x))
# ---------- end python_5 ----------
python_6 = GhPythonScript(x=panel_13)  # -> out, a; inputs x: list; same code as python_5
panel_14 = Panel(python_5.a)
panel_15 = Panel(python_6.a)
python_7 = GhPythonScript(x=panel_14)  # -> out, a
# ---------- python_7: Python ----------
__author__ = "orcun"
__version__ = "2020.02.21"

import rhinoscriptsyntax as rs
if x=="north":
    a=0
elif x=="east":
    a=1
elif x=="south":
    a=2
elif x=="west":
    a=3
elif x=="north-east":
    a=0.5
elif x=="south-east":
    a=1.5
elif x=="south-west":
    a=2.5
elif x=="north-west":
    a=3.5
elif x=="non":
    a=7
# ---------- end python_7 ----------
python_8 = GhPythonScript(x=panel_15)  # -> out, a; same code as python_7
panel_16 = Panel(python_7.a)
panel_17 = Panel(python_8.a)
sort = SortList(Keys=panel_16, ValuesA=panel_16)  # -> Keys, ValuesA
sort_2 = SortList(Keys=panel_17, ValuesA=panel_17)  # -> Keys, ValuesA
panel_18 = Panel(sort.ValuesA)
panel_19 = Panel(sort_2.ValuesA)

# ----
# Main List
panel_20 = Panel("""0
0.5
1
1.5
2
2.5
3
3.5""")

# ----
# Main List
panel_21 = Panel("""0
0.5
1
1.5
2
2.5
3
3.5""")

# ----
# Assign 1
# if the element in the main list
python_9 = GhPythonScript(x=simplify(panel_20), y=panel_18)  # -> out, a; inputs x: list, y: list
# ---------- python_9: Python ----------
"""Provides a scripting component.
    Inputs:
        x: The x script variable
        y: The y script variable
    Output:
        a: The a output variab
le"""

__author__ = "orcun"
__version__ = "2020.02.21"

import rhinoscriptsyntax as rs

matches = set(x).intersection(y)
candidates = set(x).union(y)
a = []
for c in sorted(candidates):
    a.append(c if c in y else 5)
# ---------- end python_9 ----------
equals = Equality(FirstNumber=python_9.a, SecondNumber="5")  # -> simplify(Equality), Inequality
python_10 = GhPythonScript(x=equals.Equality)  # -> out, a; inputs x: list
# ---------- python_10: Python ----------
__author__ = "orcun"
__version__ = "2020.02.24"

import rhinoscriptsyntax as rs
a = []
for i in range(len(x)):
    if x[i] == True:
        a.append(0)
    else:
        a.append(1)
# ---------- end python_10 ----------

# ----
# Compare two list
# then find difference
python_11 = GhPythonScript(x=simplify(panel_20), y=panel_18)  # -> out, a; inputs x: list, y: list
# ---------- python_11: Python ----------
"""Provides a scripting component.
    Inputs:
        x: The x script variable
        y: The y script variable
    Output:
        a: The a output variab
le"""

__author__ = "orcun"
__version__ = "2020.02.21"

import rhinoscriptsyntax as rs

def Diff(x,y):
    return (list(set(x) - set(y)))

a = Diff(x,y)
a.sort()
# ---------- end python_11 ----------

# ----
# Assign 1
# if the element in the main list
python_12 = GhPythonScript(x=simplify(panel_21), y=panel_19)  # -> out, a; inputs x: list, y: list; same code as python_9
equals_2 = Equality(FirstNumber=python_12.a, SecondNumber="5")  # -> simplify(Equality), Inequality
python_13 = GhPythonScript(x=equals_2.Equality)  # -> out, a; inputs x: list; same code as python_10

# ----
# Compare two list
# then find difference
python_14 = GhPythonScript(x=simplify(panel_21), y=panel_19)  # -> out, a; inputs x: list, y: list; same code as python_11

panel_22 = Panel(python_10.a)
panel_23 = Panel(python_13.a)
join = TextJoin(Text=panel_23, Join=",")  # -> flatten(Result)
join_2 = TextJoin(Text=panel_22, Join=",")  # -> flatten(Result)
panel_24 = Panel(join)
panel_25 = Panel(join_2)
